# Grasshopper definition 231204_GenScript.gh (Grasshopper 1.0.7)
# plug-ins: RhinoCodePluginGH

# General goal is to go through all the previous precidents and come up with digital tools that can leviate parts of the burden from the student espeacill in area/ co2/ cost estimation but not to help them build the whole house
panel = Panel("Type Selection")
panel_2 = Panel("Holz")
panel_3 = Panel("Beton/ Stein")
function = ValueList({"Structure": 1, "Boden": 2, "Fassaden": 3, "Dach": 4}, selected="Structure")
# Rule Generation based on Type of materials and purposes
script = Script(material="Stahl", function=function)  # -> Out, A
geometry = Geometry([<curve referenced from the Rhino model> x4])
geometry_2 = Geometry([<extrusion referenced from the Rhino model> x6])
panel_4 = Panel("Algorithm provider")
script_2 = Script(things=geometry_2, lines=geometry)  # -> out, a; inputs things: list of Brep, lines: list of Line
# ---------- script_2: Python ----------
import Rhino.Geometry as rg

Alg1 = "LengthAlgorithm"
Alg2 = "PackingAlgorithm" 


# LengthAlgorithm Meow
# -------------------------------------------------
# nearest neighbour
def find_closest_element(target, lst):
    return min(lst, key=lambda x: abs(x - target))

# nearest positive neighbour return null if no bigger is found
def find_closest_larger_element(target, lst):
    temp = [list(filter(lambda x: x>=0, map(lambda x: (x-num), target)))
    for num in lst]
    temp = [sublist[0] if len(sublist) != 0 else None for sublist in temp]
    return temp


def find_closest_elements(list_a, list_b, mode):
    if mode == "cloest":
        return [find_closest_element(target, list_a) for target in list_b]
    elif mode == "cloestPositive":
        return [find_closest_larger_element(target, list_a) if target != None else None
        for target in list_b]

# List_a should contain UUID of the object 
# ideallly it should be a list of dictionary of 
# {UUID, Length, Quantity}
list_a = [4000, 4000, 4000, 6000, 6000, 5500]
UUID_a = ["a", "b", "c", "d", "e"]
list_b = [line.Length for line in lines]

result = find_closest_elements(list_a, list_b, "cloest")
print(find_closest_larger_element(list_a, list_b))

# On what cases are possible to add ? 
for line in lines:
    print(line.Length)

print(result)
# ---------- end script_2 ----------
panel_5 = Panel("Optimization")
panel_6 = Panel("Visualization")
